# Grasshopper definition main.gh (Grasshopper 1.0.8)
# plug-ins: RhinoCodePluginGH

# ---- group: V world에서 받아온 zip 파일 그대로 연결
zip_file = FilePath("C:\Users\bsh96\Desktop\EDDM\week5\37612010.zip")

# ----
vworld_shp_zip_to_3d_model = Python3Script(script=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, path=zip_file)  # -> out, contour_crvs, mesh_terrain, bldg_breps, road_regions, road_centerlines; inputs path: String; unedited script template
geo = Geometry(vworld_shp_zip_to_3d_model.contour_crvs)
geo_2 = Geometry(vworld_shp_zip_to_3d_model.mesh_terrain)
geo_3 = Geometry(vworld_shp_zip_to_3d_model.bldg_breps)
geo_4 = Geometry(vworld_shp_zip_to_3d_model.road_regions)
geo_5 = Geometry(vworld_shp_zip_to_3d_model.road_centerlines)
